# Grasshopper definition housing.gh (Grasshopper 0.9.76)

height = Slider(30, range=20..50)
length = Slider(100, range=75..125)
width = Slider(100, range=75..125)

division = Division(A=height, B=2)
division_2 = Division(A=length, B=2)
division_3 = Division(A=width, B=2)
main_radius = Slider(5, range=0..10)
construct_point = ConstructPoint(XCoordinate=expr("-x", division_2), YCoordinate=expr("-x", division_3), ZCoordinate=expr("-x", division))
construct_point_2 = ConstructPoint(XCoordinate=division_2, YCoordinate=division_3, ZCoordinate=division)
xz_plane = XZPlane(Origin=Point(0, 0, 0))
yz_plane = YZPlane(Origin=Point(0, 0, 0))
xy_plane = XYPlane(Origin=Point(0, 0, 0))
subtraction = Subtraction(A=division_3, B=main_radius)
subtraction_2 = Subtraction(A=division_2, B=main_radius)
subtraction_3 = Subtraction(A=division, B=main_radius)
plane_offset = PlaneOffset(BasePlane=xy_plane, Offset=expr("-x", subtraction_3))
plane_offset_2 = PlaneOffset(BasePlane=xz_plane, Offset=expr("-x", subtraction))
plane_offset_3 = PlaneOffset(BasePlane=xy_plane, Offset=subtraction_3)
plane_offset_4 = PlaneOffset(BasePlane=xz_plane, Offset=subtraction)
plane_offset_5 = PlaneOffset(BasePlane=yz_plane, Offset=expr("-x", subtraction_2))
plane_offset_6 = PlaneOffset(BasePlane=yz_plane, Offset=subtraction_2)
construct_point_3 = ConstructPoint(XCoordinate=expr("-x", subtraction_2), YCoordinate=expr("-x", subtraction), ZCoordinate=expr("-x", subtraction_3))
construct_point_4 = ConstructPoint(XCoordinate=subtraction_2, YCoordinate=subtraction, ZCoordinate=subtraction_3)
rectangle_2pt = Rectangle2Pt(Plane=plane_offset_3, PointA=construct_point_2, PointB=construct_point, Radius=main_radius)  # -> Rectangle, Length
rectangle_2pt_2 = Rectangle2Pt(Plane=plane_offset_4, PointA=construct_point_2, PointB=construct_point, Radius=main_radius)  # -> Rectangle, Length
rectangle_2pt_3 = Rectangle2Pt(Plane=plane_offset, PointA=construct_point_2, PointB=construct_point, Radius=main_radius)  # -> Rectangle, Length
rectangle_2pt_4 = Rectangle2Pt(Plane=plane_offset_2, PointA=construct_point_2, PointB=construct_point, Radius=main_radius)  # -> Rectangle, Length
rectangle_2pt_5 = Rectangle2Pt(Plane=plane_offset_6, PointA=construct_point_2, PointB=construct_point, Radius=main_radius)  # -> Rectangle, Length
rectangle_2pt_6 = Rectangle2Pt(Plane=plane_offset_5, PointA=construct_point_2, PointB=construct_point, Radius=main_radius)  # -> Rectangle, Length
mirror = Mirror(Geometry=construct_point_4, Plane=yz_plane)  # -> Geometry, Transform
loft = Loft(
    Curves=[rectangle_2pt.Rectangle, rectangle_2pt_3.Rectangle],
    Options={Adjust=False, Closed=False, LoftEnds=0, LoftSimp=0, LoftType=0, Rebuild=10, Refit=0.01})
loft_2 = Loft(
    Curves=[rectangle_2pt_2.Rectangle, rectangle_2pt_4.Rectangle],
    Options={Adjust=False, Closed=False, LoftEnds=0, LoftSimp=0, LoftType=0, Rebuild=10, Refit=0.01})
loft_3 = Loft(
    Curves=[rectangle_2pt_5.Rectangle, rectangle_2pt_6.Rectangle],
    Options={Adjust=False, Closed=False, LoftEnds=0, LoftSimp=0, LoftType=0, Rebuild=10, Refit=0.01})
mirror_2 = Mirror(Geometry=[mirror.Geometry, construct_point_4], Plane=xz_plane)  # -> Geometry, Transform
cap_holes = CapHoles(Brep=loft)
cap_holes_2 = CapHoles(Brep=loft_2)
cap_holes_3 = CapHoles(Brep=loft_3)
sphere = Sphere(Base=[mirror_2.Geometry, construct_point_4, mirror.Geometry], Radius=main_radius)

mirror_3 = Mirror(Geometry=construct_point_3, Plane=yz_plane)  # -> Geometry, Transform
mirror_4 = Mirror(Geometry=[mirror_3.Geometry, construct_point_3], Plane=xz_plane)  # -> Geometry, Transform
sphere_2 = Sphere(Base=[mirror_4.Geometry, mirror_3.Geometry, construct_point_3], Radius=main_radius)

solid_union = SolidUnion(Breps=[cap_holes_2, cap_holes, cap_holes_3, sphere, sphere_2])

wall_thickness = Slider(2, range=1..5)
deconstruct_brep = DeconstructBrep(Brep=solid_union)  # -> Faces, Edges, Vertices
flatten_tree = FlattenTree(Tree=deconstruct_brep.Faces, Path="{0}")
offset = Offset(Surface=flatten_tree, Distance=expr("-x", wall_thickness), Retrim=True)
brep_join = BrepJoin(Breps=offset)  # -> Breps, Closed

gap = Slider(0.1, range=0..1)
xy_plane_2 = XYPlane(Origin=Point(0, 0, 0))
division_4 = Division(A=gap, B=2)
plane_offset_7 = PlaneOffset(BasePlane=xy_plane_2, Offset=expr("-x", division))
plane_offset_8 = PlaneOffset(BasePlane=xy_plane_2, Offset=division_4)
plane_offset_9 = PlaneOffset(BasePlane=xy_plane_2, Offset=expr("-x", division_4))
plane_offset_10 = PlaneOffset(BasePlane=xy_plane_2, Offset=division)
rectangle_2pt_7 = Rectangle2Pt(Plane=plane_offset_8, PointA=construct_point_2, PointB=construct_point, Radius=0)  # -> Rectangle, Length
rectangle_2pt_8 = Rectangle2Pt(Plane=plane_offset_9, PointA=construct_point_2, PointB=construct_point, Radius=0)  # -> Rectangle, Length
rectangle_2pt_9 = Rectangle2Pt(Plane=plane_offset_10, PointA=construct_point_2, PointB=construct_point, Radius=0)  # -> Rectangle, Length
rectangle_2pt_10 = Rectangle2Pt(Plane=plane_offset_7, PointA=construct_point_2, PointB=construct_point, Radius=0)  # -> Rectangle, Length
loft_4 = Loft(
    Curves=[rectangle_2pt_9.Rectangle, rectangle_2pt_8.Rectangle],
    Options={Adjust=False, Closed=False, LoftEnds=0, LoftSimp=0, LoftType=0, Rebuild=10, Refit=0.01})
loft_5 = Loft(
    Curves=[rectangle_2pt_7.Rectangle, rectangle_2pt_10.Rectangle],
    Options={Adjust=False, Closed=False, LoftEnds=0, LoftSimp=0, LoftType=0, Rebuild=10, Refit=0.01})
cap_holes_4 = CapHoles(Brep=loft_4)
cap_holes_5 = CapHoles(Brep=loft_5)
solid_difference = SolidDifference(BrepsA=solid_union, BrepsB=cap_holes_4)
solid_difference_2 = SolidDifference(BrepsA=solid_union, BrepsB=cap_holes_5)
solid_difference_3 = SolidDifference(BrepsA=solid_difference_2, BrepsB=brep_join.Breps)
solid_difference_4 = SolidDifference(BrepsA=solid_difference, BrepsB=brep_join.Breps)
